# Grasshopper definition Demo.gh (Grasshopper 1.0.7)
# plug-ins: RodSteward

# ---- group: From Mesh Demo
button = Button()
msphereex = MeshSphereEx(Base=PlaneXY(0, 0, 0), Radius="1000", Count=Slider(3, range=0..10))
rsmesh2graph = Mesh2Graph(Mesh=msphereex)  # -> Edges, Vertices
rsgenerator = Generator(
    Edges=rsmesh2graph.Edges,
    Vertices=rsmesh2graph.Vertices,
    Sides=Slider(3, range=3..10),
    Radius=Slider(11.9, range=3..20),
    JointThickness=Slider(3.2, range=0..10),
    JointLength=Slider(36, range=0..100),
    Tolerance=Slider(0.02, range=0..3),
    annotatejointarms=False,
    annotatejoints=False,
    annotaterods=False,
    collision=False,
    printlabel=False)  # -> Model, Joints, Rods, RodCurves
rsoutputrodcutsvg = OutputRodCutSVG(Model=rsgenerator.Model, StockLength=Slider(1000, range=0..1000), Directory="C:\RS-GH_Demo_1", WriteTrigger=button)  # -> Output, CuttingPlan
rsoutputjointstl = OutputJointSTL(Model=rsgenerator.Model, Directory="C:\RS-GH_Demo_1", WriteTrigger=button)
rssequencer = Sequencer(
    Model=rsgenerator.Model,
    StartingJoint=Slider(0, range=0..163),
    PartNumber=Slider(91, range=0..163),
    annotatejointarms=True,
    annotatejoints=True,
    annotaterods=True)
panel = Panel(rsoutputjointstl)
panel_2 = Panel(rsoutputrodcutsvg.Output)
panel_3 = Panel(rsoutputrodcutsvg.CuttingPlan)
panel_4 = Panel(rssequencer)

# ---- group: From Lines Demo
button_2 = Button()
scale = Scale(Geometry=msphereex, Center=Point(0, 0, 0), Factor="0.5")  # -> Geometry, Transform
medges = MeshEdges(Mesh=scale.Geometry)  # -> NakedEdges, InteriorEdges, NonManifoldEdges
rslines2graph = Lines2Graph(Lines=medges.InteriorEdges, Tolerance="10")  # -> Edges, Vertices
rsgenerator_2 = Generator(
    Edges=rslines2graph.Edges,
    Vertices=rslines2graph.Vertices,
    Sides=Slider(3, range=3..10),
    Radius=Slider(10.6, range=3..20),
    JointThickness=Slider(3.2, range=0..10),
    JointLength=Slider(36, range=0..100),
    Tolerance=Slider(0.02, range=0..3),
    annotatejointarms=False,
    annotatejoints=False,
    annotaterods=False,
    collision=False,
    printlabel=False)  # -> Model, Joints, Rods, RodCurves
rsoutputrodcutsvg_2 = OutputRodCutSVG(Model=rsgenerator_2.Model, StockLength=Slider(1000, range=0..1000), Directory="C:\RS-GH_Demo_2", WriteTrigger=button_2)  # -> Output, CuttingPlan
rsoutputjointstl_2 = OutputJointSTL(Model=rsgenerator_2.Model, Directory="C:\RS-GH_Demo_2", WriteTrigger=button_2)
rssequencer_2 = Sequencer(
    Model=rsgenerator_2.Model,
    StartingJoint=Slider(18, range=0..163),
    PartNumber=Slider(91, range=0..163),
    annotatejointarms=True,
    annotatejoints=True,
    annotaterods=True)
panel_5 = Panel(rsoutputrodcutsvg_2.CuttingPlan)
panel_6 = Panel(rsoutputjointstl_2)
panel_7 = Panel(rsoutputrodcutsvg_2.Output)
panel_8 = Panel(rssequencer_2)
